% Simulink data dictionary Navigation.sldd

starTracker_meas = Simulink.Bus()  % star tracker measurements bus
  timestamp: double, Unit="sec"  % measure timestamp
  quaternion: double[4 1]  % measured quaternion

IMU_meas = Simulink.Bus()  % IMU measurements
  acc_timestamp: double, Unit="sec"  % timestamp of acceleration measurement
  gyro_timestamp: double, Unit="sec"  % timestamp of gyroscope measurement
  acc: double[3 1], Unit="m/s^2"  % measured acceleration
  gyro: double[3 1], Unit="rad/s"  % measured angular rates

radio_meas = Simulink.Bus()
  range_PN: double, Unit="m"  % Range measurements using the pseudo-noise signal
  range_CP: double, Unit="m"  % Range measurements using the carrier phase measurement
  range_rate: double, Unit="m/s"  % Range rate measurements
  range_timestamp: double, Unit="s"  % Range timestamp
  range_rate_timestamp: double, Unit="s"  % Range rate timestamp

Measurements = Simulink.Bus()  % Bus containing all the measurements
  radio: Bus: radio_meas
  IMU: Bus: IMU_meas
  starTracker: Bus: starTracker_meas

Propagation = struct(
  lf=struct(value=5, unit="Hz", description="State propagation frequency"),
  hf=struct(value=30, unit="Hz", description="Higher propagation frequency for IMU error comoensation algorithms"),
  Earth=struct(
    mu=struct(value="km^3/s^2", description="Earth gravitational parameter"),
    amp=struct(
      value=[-383000 -31500 -10600 -6200 -3200 -2300 -800
       -351000 -28900 -13700 -9700 -5700 -2900 -2100
       -153200 -31500 -12500 -4200 -2500 -3000 -1800],
      unit="km",
      description="Amplitude coefficients for the position of the simplified earth model"),
    freq=struct(
      value=[8399.685 70.99 16728.377 1185.622 7143.07 15613.745 8467.263
       8399.687 70.997 8433.466 16728.38 1185.667 7143.058 15613.755
       8399.672 8433.464 70.996 16728.364 1185.645 104.881 8399.116],
      unit="Hz",
      description="Frequency coefficients for the position of the simplified earth model"),
    phase=struct(
      value=[5.381 6.169 1.453 0.481 5.017 0.857 1.01
       3.811 4.596 4.766 6.165 5.164 0.3 5.565
       3.807 1.629 4.595 6.162 5.167 2.555 6.248],
      unit="rad",
      description="phase coefficients for the position of the simplified earth model")))